# Grasshopper definition wire3dp.gh (Grasshopper 1.0.7)

number_slider = Slider(29, range=0..100)
square = Square(Plane=PlaneXY(0, 0, 0), Size=1, ExtentX=number_slider, ExtentY=number_slider)  # -> Cells, Points
flatten_tree = FlattenTree(Tree=square.Cells, Path="{0}")
group = Group(Objects=flatten_tree)
bounding_box = BoundingBox(Content=group, Plane=PlaneXY(0, 0, 0))  # -> Box, Box_2
curve = Curve([<curve referenced from the Rhino model> x2])
loft = Loft(Curves=curve, Options={Adjust=False, Closed=False, LoftEnds=0, LoftSimp=0, LoftType=0, Rebuild=10, Refit=0.01})
deconstruct_brep = DeconstructBrep(Brep=bounding_box.Box)  # -> Faces, Edges, Vertices
list_item = ListItem(List=deconstruct_brep.Faces, Index=0, Wrap=True)
surface = Surface(<surface referenced from the Rhino model>)
map_to_surface = MapToSurface(Curve=flatten(square.Cells), Source=list_item, Target=loft)
discontinuity = Discontinuity(Curve=map_to_surface, Level=1)  # -> Points, Parameters
surface_closest_point = SurfaceClosestPoint(Point=discontinuity.Points, Surface=loft)  # -> Point, UVPoint, Distance
evaluate_surface = EvaluateSurface(Surface=loft, Point=surface_closest_point.UVPoint)  # -> Point, Normal, UDirection, VDirection, Frame
deconstruct = Deconstruct(Point=evaluate_surface.Normal)  # -> XComponent, YComponent, ZComponent
vector_display = VectorDisplay(Anchor=evaluate_surface.Point, Vector=evaluate_surface.Normal)
vector_xyz = VectorXYZ(XComponent=deconstruct.XComponent, YComponent=deconstruct.YComponent, ZComponent=0)  # -> Vector, Length
amplitude = Amplitude(Vector=vector_xyz.Vector, Amplitude=Slider(20, range=0..100))
move = Move(Geometry=evaluate_surface.Point, Motion=amplitude)  # -> Geometry, Transform
flip_matrix = FlipMatrix(Data=discontinuity.Points)
flip_matrix_2 = FlipMatrix(Data=move.Geometry)
explode_tree = ExplodeTree(Data=flip_matrix_2)  # -> _0000, _0001, _0002, _0003
explode_tree_2 = ExplodeTree(Data=flip_matrix)  # -> _0000, _0001, _0002, _0003
twisted_box = TwistedBox(
    CornerA=explode_tree_2._0000,
    CornerB=explode_tree_2._0001,
    CornerC=explode_tree_2._0002,
    CornerD=explode_tree_2._0003,
    CornerE=explode_tree._0000,
    CornerF=explode_tree._0001,
    CornerG=explode_tree._0002,
    CornerH=explode_tree._0003)
